# Dynamo graph Перевод_TM_Rect to WGS-84_MSK-50-2.dyn (Dynamo 2.11.0.4172)

datum_ToWGS84_SK95_EPSG5043 = MapConnection.ResourceLibrary.Datum_ToWGS84_SK95_EPSG5043()
getDatumInfo = MapConnection.GeneralTerms.GetDatumInfo(InfoAboutDatum=datum_ToWGS84_SK95_EPSG5043)
code_block = CodeBlock { "Krassowsky 1940, EPSG:7024"; "WGS-84, EPSG:7030"; }
ellipsoidParameters = MapConnection.GeneralTerms.EllipsoidParameters(EllipsoidName=code_block.out0)
ellipsoidParameters_2 = MapConnection.GeneralTerms.EllipsoidParameters(EllipsoidName=code_block.out1)
CS_Russia_MSK50_Zona2 = MapConnection.ResourceLibrary.CS_Russia_MSK50_Zona2()
getCSParameters = MapConnection.GeneralTerms.GetCSParameters(CS_Name=CS_Russia_MSK50_Zona2)
number = DoubleInput(222821641)
number_2 = DoubleInput(530448796)
TM_FromRectangleToGeodetic = MapConnection.CoordTransform.TM_FromRectangleToGeodetic(Ellipsoid=ellipsoidParameters, CS_Params=getCSParameters, CoordX=number, CoordY=number_2)
number_3 = DoubleInput(212.87)
datum_Recalculation = MapConnection.GeneralTerms.Datum_Recalculation(DatumInfo=getDatumInfo, SourceEllipsoid=ellipsoidParameters, FinishEllipsoid=ellipsoidParameters_2, Latitude=TM_FromRectangleToGeodetic.Latitude_radians, Longitude=TM_FromRectangleToGeodetic.Longitude_radians, Height=number_3)
watch = Watch(datum_Recalculation.Latitude_grades)
watch_2 = Watch(datum_Recalculation.Longitude_grades)
watch_3 = Watch(getDatumInfo)
watch_4 = Watch(TM_FromRectangleToGeodetic.Latitude_grades)
